# Dynamo graph Xframe3D Supports to Revit.dyn (Dynamo 2.0.2.6826)

file_path = Filename("..\..\..\..\Bureaublad\TEMP\943_5.4_Fundering2.xml")  # graph input
xframe3DImportXML = Custom[Xframe3DImportXML](xmlFile=file_path)
watch = Watch(xframe3DImportXML.nodeNumbers)
watch_2 = Watch(xframe3DImportXML.support_nodenumber)
string_from_object = FromObject(obj=watch_2)
string_from_object_2 = FromObject(obj=xframe3DImportXML.nodeNumbers)
eq = string_from_object_2 == _  # unwired: y; lacing=Longest
map = List.Map(list=string_from_object, f_x=eq)
